# Grasshopper definition columns 03.ghx (Grasshopper 1.0.7)
# plug-ins: Speckle 2

panel = Panel("https://macad.speckle.xyz/projects/af5d09c237/models/3a336dd495")
txt = Text()
sr = SynchronousReceiver(
    Stream=panel,
    AutoReceive=False,
    ReceivedObjectId="fe8a71d9ca2d25c843297a561bd139f1",
    StreamWrapper="https://macad.speckle.xyz/projects/af5d09c237/models/3a336dd495",
    selectedKitName="Objects")  # -> Data, Info
pt = Point(sr.Data)
intcrv = Interpolate(Vertices=pt, Degree=Slider(1, range=0..10), Periodic=Toggle(True), KnotStyle=1)  # -> Curve, Length, Domain
srf = Surface(graft(intcrv.Curve))
planar = IsPlanar(Surface=srf, Interior=True)  # -> Planar, Plane
project = Project(Geometry=srf, Plane=planar.Plane)  # -> Geometry, Transform
area = Area(Geometry=project.Geometry)  # -> Area, graft(Centroid)
item = ListItem(List=flatten(area.Centroid), Index=0, Wrap=True)  # -> Item1, Item
series = Series(Start="1", Step=1, Count="47")
eval = Evaluate(F="3*((2+(N-2)*0.7)/N)", N=series)
number_slider = Slider(10, range=0..100)
cir = Circle(Plane=item.Item, Radius=Slider(26, range=0..100))
cir_2 = Circle(Plane=item.Item1, Radius=Slider(16, range=0..100))
ma = MassAddition(Input=eval)  # -> Result, PartialResults
panel_2 = Panel(eval)
panel_3 = Panel(ma.Result)
panel_4 = Panel(ma.PartialResults)
divide = DivideCurve(Curve=cir_2, Count=number_slider, Kinks=False)  # -> Points, Tangents, Parameters
divide_2 = DivideCurve(Curve=cir, Count=number_slider, Kinks=False)  # -> Points, Tangents, Parameters
panel_5 = Panel("""0
-1""")
ln = Line(StartPoint=divide.Points, EndPoint=divide_2.Points)
srf_2 = Surface(flatten(srf))
multiplication = Multiplication(A=panel_4, B="10000")
cull_i = CullIndex(List=srf_2, Indices=panel_5, Wrap=True)
expression = Expression(P=multiplication, Expression="Sqrt(P / (10^7))")
split = SplitWithBreps(Curve=ln, Brep=cull_i)  # -> Curve, Points
item_2 = ListItem(List=flatten(split.Curve), Index=0, Wrap=True)
flip = FlipMatrix(Data=split.Curve)
panel_6 = Panel(expression)
len = Length(Curve=item_2)
crv = Curve(flip)
division = Division(A=len, B=Slider(500, range=0..1000))
multiplication_2 = Multiplication(A=division, B=Slider(1000, range=0..1000))
multiplication_3 = Multiplication(A=panel_6, B=Slider(1.5, range=0..10))
num = Number(multiplication)
multiplication_4 = Multiplication(A=multiplication_3, B=Slider(100, range=0..100))
expression_2 = Expression(P=num, L=multiplication_4, b=multiplication_3, E="20e9", Expression="(P * L) / (b^2 * E)")
panel_7 = Panel(expression_2)
len_2 = Length(Curve=crv)
item_3 = ListItem(List=len_2, Index=0, Wrap=True)
multiplication_5 = Multiplication(A=panel_7, B=Slider(1000, range=0..1000))
rectangle = Rectangle(Plane=crv, XSize=graft(multiplication_3), YSize=graft(multiplication_3), Radius=0)  # -> Rectangle, Length
neg = Negative(Value=item_3)
panel_8 = Panel(multiplication_5)
Z = UnitZ(Factor=neg)
srf_3 = Surface(rectangle.Rectangle)
extr = Extrude(Base=srf_3, Direction=Z)
item_4 = ListItem(List=panel_8, Index="-1", Wrap=True)
panel_9 = Panel(item_4)
cso = CreateSpeckleObject(A=extr, selectedKitName="Objects")
txt_2 = Text()
sgetwt = StreamGetWithToken(Stream=txt_2, AuthToken="0a7a2c01a136ad89e2cfa5e002c9f1bcbe5656a1d0")
ss = SynchronousSender(Data=cso, Stream=sgetwt, UseDefaultCache=True, selectedKitName="Objects")
