# Grasshopper definition columns workflow.ghx (Grasshopper 1.0.8)
# plug-ins: Speckle 2

# ---- group: receive from residential team / RH_IN:Send
txt = Text()

# ----
panel = Panel("https://macad.speckle.xyz/projects/af5d09c237/models/0aa2d6f0aa")

# ---- group: receive from residential team
synchronous_receiver = SynchronousReceiver(
    Stream=txt,
    AutoReceive=False,
    ReceivedObjectId="696ed7f514c0cd036ac3873a5d1df7f9",
    StreamWrapper="https://macad.speckle.xyz/projects/af5d09c237/models/0aa2d6f0aa",
    selectedKitName="Objects")  # -> Data, Info

# ----
receive = Receive(
    Stream=panel,
    AutoReceive=False,
    CurrentComponentState="expired",
    ExpandOutput=True,
    LastInfoMessage="ERVA Hofi @ 03/23/2025 04:42:25: Sent 1702 objects from Revit2025. (id:8bebd58276)",
    ReceiveOnOpen=False,
    ReceivedCommitId="8bebd58276",
    StreamWrapper="https://macad.speckle.xyz/projects/af5d09c237/models/floorplates_v1",
    selectedKitName="Objects")  # -> Info, CollectionType, Elements, Info_2, Materials, Name, ProjectInformation, Sheets, Types, Views
receive_2 = Receive(
    Stream=panel,
    AutoReceive=False,
    CurrentComponentState="up_to_date",
    ExpandOutput=True,
    LastInfoMessage="ERVA Hofi @ 03/23/2025 15:04:30: Pushed 571 elements from Grasshopper. (id:1d42d6e789)",
    ReceiveOnOpen=False,
    ReceivedCommitId="1d42d6e789",
    StreamWrapper="https://macad.speckle.xyz/projects/af5d09c237/models/floorplates_v1",
    selectedKitName="Objects")  # -> Info, Data
crv = Curve()
pt = Point(synchronous_receiver.Data)
intcrv = Interpolate(Vertices=pt, Degree=Slider(1, range=0..3), Periodic=Toggle(True), KnotStyle=1)  # -> Curve, Length, Domain

# ---- group: Loads calculation
series = Series(Start="1", Step=1, Count="47")
eval = Evaluate(F="3*((2+(N-2)*0.7)/N)", N=series)
ma = MassAddition(Input=eval)  # -> Result, PartialResults
total_load_kn = Panel(ma.Result)
kn_floor = Panel(eval)
sum_of_kn_floor = Panel(ma.PartialResults)
panel_2 = Panel(sum_of_kn_floor)
multiplication = Multiplication(A=panel_2, B="10000")
expression = Expression(P=multiplication, Expression="Sqrt(P / (10^7))")
panel_3 = Panel(expression)

# ---- group: Displacement Calculation
multiplication_2 = Multiplication(A=panel_3, B=Slider(1.5, range=0..10))
num = Number(multiplication)
multiplication_3 = Multiplication(A=multiplication_2, B="100")
expression_2 = Expression(P=num, L=multiplication_3, b=multiplication_2, E="20e9", Expression="(P * L) / (b^2 * E)")
panel_4 = Panel(multiplication_2)
panel_5 = Panel(expression_2)
multiplication_4 = Multiplication(A=panel_5, B="1000")
panel_6 = Panel(multiplication_4)
item = ListItem(List=panel_6, Index="-1", Wrap=True)

# ---- group: Displacement NO.
panel_7 = Panel(item)

# ----
# First Check of the displacement NO.
# If the displacement NO. is larger than the allowable range send it to the next script,
# if it's smaller than the range send the columns to STRUCUTRE PROJECT IN SPECKLE
surface = Surface(graft(intcrv.Curve))
radius_bottom = Slider(26, range=10..30)
is_planar = IsPlanar(Surface=surface, Interior=True)  # -> Planar, Plane
of_columns_main_beams = Slider(10, range=0..30)
radius_top = Slider(16, range=10..20)
project = Project(Geometry=surface, Plane=is_planar.Plane)  # -> Geometry, Transform
area = Area(Geometry=project.Geometry)  # -> Area, graft(Centroid)
list_item = ListItem(List=flatten(area.Centroid), Index=0, Wrap=True)  # -> Item1, Item
# Towers Structural System
circle = Circle(Plane=list_item.Item1, Radius=radius_top)
circle_2 = Circle(Plane=list_item.Item, Radius=radius_bottom)
divide_curve = DivideCurve(Curve=circle, Count=of_columns_main_beams, Kinks=False)  # -> Points, Tangents, Parameters
divide_curve_2 = DivideCurve(Curve=circle_2, Count=of_columns_main_beams, Kinks=False)  # -> Points, Tangents, Parameters
surface_2 = Surface(flatten(surface))
line = Line(StartPoint=divide_curve.Points, EndPoint=divide_curve_2.Points)
panel_8 = Panel("""0
-1""")
cull_index = CullIndex(List=surface_2, Indices=panel_8, Wrap=True)  # -> graft(List)
split_with_breps = SplitWithBreps(Curve=line, Brep=flatten(cull_index))  # -> Curve, Points
flip_matrix = FlipMatrix(Data=split_with_breps.Curve)
item_2 = ListItem(List=flatten(split_with_breps.Curve), Index=0, Wrap=True)
len = Length(Curve=item_2)
curve = Curve(flip_matrix)
panel_9 = Panel(len)
division = Division(A=len, B="500")
panel_10 = Panel(division)
multiplication_5 = Multiplication(A=division, B="1000")
panel_11 = Panel(multiplication_5)
larger = LargerThan(FirstNumber=panel_7, SecondNumber=panel_11)  # -> LargerThan, OrEqualTo
panel_12 = Panel(larger.OrEqualTo)
bool = Boolean(panel_12)

# ---- group: Columns Creator
len_2 = Length(Curve=curve)
item_3 = ListItem(List=len_2, Index=0, Wrap=True)
rectangle = Rectangle(Plane=curve, XSize=graft(multiplication_2), YSize=graft(multiplication_2), Radius=0)  # -> Rectangle, Length
neg = Negative(Value=item_3)
Z = UnitZ(Factor=neg)
srf = Surface(rectangle.Rectangle)
extr = Extrude(Base=srf, Direction=Z)

# ---- group: First Check for the displacement NO.
cso = CreateSpeckleObject(A=curve, selectedKitName="Objects")
cso_2 = CreateSpeckleObject(B=rectangle.Rectangle, selectedKitName="Objects")
cso_3 = CreateSpeckleObject(C=extr, selectedKitName="Objects")
num_2 = Number(multiplication)
cso_4 = CreateSpeckleObject(ColumnsCurves=cso, CrossSection=cso_2, Columns=cso_3, Loads=num_2, selectedKitName="Objects")
filter = StreamFilter(Gate=bool, Stream0=cso_3, Stream1=cso_4)
gate = StreamGate(Stream=filter, Gate=bool)  # -> Target0, Target1
panel_13 = Panel("https://macad.speckle.xyz/projects/7f5a70ef59/models/d62f789cfe")
panel_14 = Panel(gate.Target1)
cso_5 = CreateSpeckleObject(C=gate.Target0, selectedKitName="Objects")
send = Send(
    Stream=panel_13,
    Data=gate.Target1,
    AutoSend=False,
    BaseId="a7ad54ac3ebf51cd9226b1f318b0aa45",
    CurrentComponentState="up_to_date",
    KitName="Objects",
    OutputWrappers="https://macad.speckle.xyz\t7f5a70ef59\t9d4832bd40",
    UseDefaultCache=True,
    selectedKitName="Objects")

# ---- group: Auto receive from script 1 to increase the sturcture thickness to reduce the displacenemnt NO.
receive_3 = Receive(
    Stream=panel_13,
    AutoReceive=True,
    CurrentComponentState="up_to_date",
    ExpandOutput=True,
    LastInfoMessage="ERVA Hofi @ 03/23/2025 00:14:14: Pushed 135011 elements from Grasshopper. (id:9d4832bd40)",
    ReceiveOnOpen=False,
    ReceivedCommitId="9d4832bd40",
    StreamWrapper="https://macad.speckle.xyz/projects/7f5a70ef59/models/structure 01",
    selectedKitName="Objects")  # -> Info, Data

# ----
filter_2 = StreamFilter(Gate=bool, Stream0=cso_3, Stream1=receive_3.Data)
gate_2 = StreamGate(Stream=filter_2, Gate=bool)  # -> Target0, Target1
dso = DeconstructSpeckleObject(SpeckleObject=gate_2.Target1, selectedKitName="Objects")  # -> Columns, ColumnsCurves, CrossSection, Loads
panel_15 = Panel(dso.Columns)
dso_2 = DeconstructSpeckleObject(SpeckleObject=dso.CrossSection, selectedKitName="Objects")
dso_3 = DeconstructSpeckleObject(SpeckleObject=dso.ColumnsCurves, selectedKitName="Objects")
panel_16 = Panel(multiplication_5)
panel_17 = Panel("https://macad.speckle.xyz/projects/7f5a70ef59/models/fa4b5e0e3d")

# ---- group: Loop to resend and receive to get the displacement NO. in range
receive_4 = Receive(
    Stream=panel_17,
    AutoReceive=True,
    CurrentComponentState="up_to_date",
    ExpandOutput=True,
    LastInfoMessage="ERVA Hofi @ 03/23/2025 00:18:06: Pushed 176324 elements from Grasshopper. (id:67a9b2b9fe)",
    ReceiveOnOpen=False,
    ReceivedCommitId="67a9b2b9fe",
    StreamWrapper="https://macad.speckle.xyz/projects/7f5a70ef59/models/structure 02",
    selectedKitName="Objects")  # -> Info, Data

# ---- group: Increasing the thickness of the strucutral elements to reduce displacement NO.
crv_2 = Curve(dso_3)
num_3 = Number(dso.Loads)
crv_3 = Curve(dso_2)
area_2 = Area(Geometry=crv_3)  # -> Area, Centroid
panel_18 = Panel(area_2.Area)
scale = Scale(Geometry=crv_3, Center=area_2.Centroid, Factor=Slider(1.1, range=0..10))  # -> Geometry, Transform
srf_2 = Surface(scale.Geometry)
area_3 = Area(Geometry=scale.Geometry)  # -> Area, Centroid
expression_3 = Expression(x=area_3.Area, Expression="sqrt(x)")
panel_19 = Panel(expression_3)
item_4 = ListItem(List=flatten(panel_19), Index="1", Wrap=True)
panel_20 = Panel(item_4)
multiplication_6 = Multiplication(A=expression_3, B=Slider(1, range=0..10))
multiplication_7 = Multiplication(A=multiplication_6, B="100")
rectangle_2 = Rectangle(Plane=crv_2, XSize=graft(panel_20), YSize=graft(panel_20), Radius=0)  # -> Rectangle, Length
srf_3 = Surface(rectangle_2.Rectangle)
expression_4 = Expression(P=num_3, L=multiplication_7, b=multiplication_6, E="20e9", Expression="(P * L) / (b^2 * E)")
panel_21 = Panel(multiplication_6)
extrcrv = ExtrudeAlong(Base=srf_3, Curve=crv_2)
extrcrv_2 = ExtrudeAlong(Base=srf_2, Curve=crv_2)
volume = Volume(Geometry=extrcrv)  # -> Volume, Centroid
panel_22 = Panel(expression_4)
panel_23 = Panel(area_3.Area)
volume_2 = Volume(Geometry=extrcrv_2)  # -> Volume, Centroid
panel_24 = Panel(volume.Volume)
ma_2 = MassAddition(Input=flatten(volume.Volume))  # -> Result, PartialResults
ma_3 = MassAddition(Input=flatten(volume_2.Volume))  # -> Result, PartialResults
panel_25 = Panel(volume_2.Volume)
panel_26 = Panel(ma_2.Result)
panel_27 = Panel(ma_3.Result)
multiplication_8 = Multiplication(A=panel_22, B="1000")
panel_28 = Panel(multiplication_8)
item_5 = ListItem(List=flatten(panel_28), Index="-1", Wrap=True)
division_2 = Division(A=panel_27, B=panel_26)
panel_29 = Panel(division_2)

# ---- group: Displacement NO.
# Second Check of the displacement NO.
# Increase the thickness of the structural elements and recalculate the displacement NO.
#  if it's still larger than the range, send it to the next script
panel_30 = Panel(item_5)

# ----
# https://macad.speckle.xyz/projects/28a211b286/models/4104f63f5f
dso_4 = DeconstructSpeckleObject(SpeckleObject=receive_4.Data, selectedKitName="Objects")  # -> Columns, ColumnsCurves, CrossSection, Loads
panel_31 = Panel(dso_4.Columns)
panel_32 = Panel(dso_4.Loads)
dso_5 = DeconstructSpeckleObject(SpeckleObject=dso_4.CrossSection, selectedKitName="Objects")
dso_6 = DeconstructSpeckleObject(SpeckleObject=dso_4.ColumnsCurves, selectedKitName="Objects")
num_4 = Number(dso_4.Loads)
panel_33 = Panel(num_4)
panel_34 = Panel(multiplication_5)

# ---- group: Increase the thickness and recalculate the displacement NO.
num_5 = Number(dso_4.Loads)
crv_4 = Curve(dso_6)
crv_5 = Curve(dso_5)
area_4 = Area(Geometry=crv_5)  # -> Area, Centroid
panel_35 = Panel(area_4.Area)
scale_2 = Scale(Geometry=crv_5, Center=area_4.Centroid, Factor=Slider(1.1, range=0..10))  # -> Geometry, Transform
srf_4 = Surface(scale_2.Geometry)
area_5 = Area(Geometry=scale_2.Geometry)  # -> Area, Centroid
expression_5 = Expression(x=area_5.Area, Expression="sqrt(x)")
panel_36 = Panel(expression_5)
item_6 = ListItem(List=flatten(panel_36), Index="1", Wrap=True)
panel_37 = Panel(item_6)
multiplication_9 = Multiplication(A=expression_5, B=Slider(1, range=0..10))
multiplication_10 = Multiplication(A=multiplication_9, B="100")
rectangle_3 = Rectangle(Plane=crv_4, XSize=graft(panel_37), YSize=graft(panel_37), Radius=0)  # -> Rectangle, Length
srf_5 = Surface(rectangle_3.Rectangle)
expression_6 = Expression(P=num_5, L=multiplication_10, b=multiplication_9, E="20e9", Expression="(P * L) / (b^2 * E)")
panel_38 = Panel(multiplication_9)
extrcrv_3 = ExtrudeAlong(Base=srf_5, Curve=crv_4)
extrcrv_4 = ExtrudeAlong(Base=srf_4, Curve=crv_4)
volume_3 = Volume(Geometry=extrcrv_3)  # -> Volume, Centroid
panel_39 = Panel(expression_6)
panel_40 = Panel(area_5.Area)
volume_4 = Volume(Geometry=extrcrv_4)  # -> Volume, Centroid
panel_41 = Panel(volume_3.Volume)
ma_4 = MassAddition(Input=flatten(volume_3.Volume))  # -> Result, PartialResults
ma_5 = MassAddition(Input=flatten(volume_4.Volume))  # -> Result, PartialResults
panel_42 = Panel(volume_4.Volume)
panel_43 = Panel(ma_4.Result)
panel_44 = Panel(ma_5.Result)
multiplication_11 = Multiplication(A=panel_39, B="1000")
panel_45 = Panel(multiplication_11)
item_7 = ListItem(List=flatten(panel_45), Index="-1", Wrap=True)
division_3 = Division(A=panel_44, B=panel_43)
panel_46 = Panel(division_3)

# ---- group: Displacement NO.
panel_47 = Panel(item_7)

# ----
num_6 = Number(num_5)
larger_2 = LargerThan(FirstNumber=panel_47, SecondNumber=panel_34)  # -> LargerThan, OrEqualTo
panel_48 = Panel(larger_2.OrEqualTo)
cso_6 = CreateSpeckleObject(A=crv_4, selectedKitName="Objects")
cso_7 = CreateSpeckleObject(B=scale_2.Geometry, selectedKitName="Objects")
cso_8 = CreateSpeckleObject(C=extrcrv_4, selectedKitName="Objects")
bool_2 = Boolean(panel_48)
cso_9 = CreateSpeckleObject(ColumnsCurves=cso_6, CrossSection=cso_7, Columns=cso_8, Loads=num_6, selectedKitName="Objects")
filter_3 = StreamFilter(Gate=bool_2, Stream0=cso_8, Stream1=cso_9)
gate_3 = StreamGate(Stream=filter_3, Gate=bool_2)  # -> Target0, Target1
panel_49 = Panel(gate_3.Target1)

# ---- group: In range, send it to the STRUCTURE PROJECT
# change "project" for "streams": https://macad.speckle.xyz/streams/a63c4e60ed
cso_10 = CreateSpeckleObject(C=gate_3.Target0, selectedKitName="Objects")
panel_50 = Panel("Receive_From_Compute Stream")
panel_51 = Panel("Bot Speckle Token")
txt_2 = Text()
sgetwt = StreamGetWithToken(Stream=txt_2, AuthToken="0a7a2c01a136ad89e2cfa5e002c9f1bcbe5656a1d0")
ss = SynchronousSender(
    Data=cso_3,
    Stream=sgetwt,
    OutputWrappers="https://macad.speckle.xyz\t27b32e7bd2\tab5404b2dc",
    UseDefaultCache=True,
    selectedKitName="Objects")

# ---- group: larger than the range, resend it to the loop
# Final LOOP of auto resend and receive to increase the strucutral elements
#  tell the displacement NO. is in range
panel_52 = Panel("https://macad.speckle.xyz/projects/7f5a70ef59/models/fa4b5e0e3d")
send_2 = Send(
    Stream=panel_52,
    Data=filter_3,
    AutoSend=False,
    BaseId="77a876728550fc5c514dc1a3534e6a4b",
    CurrentComponentState="expired",
    KitName="Objects",
    OutputWrappers="https://macad.speckle.xyz\t7f5a70ef59\tc7cb06f117",
    UseDefaultCache=True,
    selectedKitName="Objects")

# ----
num_7 = Number(num_3)
larger_3 = LargerThan(FirstNumber=panel_30, SecondNumber=panel_16)  # -> LargerThan, OrEqualTo
panel_53 = Panel(larger_3.OrEqualTo)
bool_3 = Boolean(panel_53)

# ----
# https://macad.speckle.xyz/projects/28a211b286/models/4104f63f5f
cso_11 = CreateSpeckleObject(A=crv_2, selectedKitName="Objects")
cso_12 = CreateSpeckleObject(B=scale.Geometry, selectedKitName="Objects")
cso_13 = CreateSpeckleObject(C=extrcrv_2, selectedKitName="Objects")
cso_14 = CreateSpeckleObject(ColumnsCurves=cso_11, CrossSection=cso_12, Columns=cso_13, Loads=num_7, selectedKitName="Objects")

filter_4 = StreamFilter(Gate=bool_3, Stream1=cso_14)
gate_4 = StreamGate(Stream=filter_4, Gate=bool_3)  # -> Target0, Target1

send_3 = Send(
    Stream=panel_17,
    Data=gate_4.Target1,
    AutoSend=True,
    BaseId="77a876728550fc5c514dc1a3534e6a4b",
    CurrentComponentState="up_to_date",
    KitName="Objects",
    OutputWrappers="https://macad.speckle.xyz\t7f5a70ef59\t67a9b2b9fe",
    UseDefaultCache=True,
    selectedKitName="Objects")
