# Grasshopper definition structure maker.gh (Grasshopper 1.0.8)
# plug-ins: Speckle 2

# ---- group: RH_IN:Send
txt = Text()

# ----
panel = Panel("https://macad.speckle.xyz/projects/28a211b286/models/f5c0c919fa")
synchronous_receiver = SynchronousReceiver(Stream=txt, AutoReceive=False, selectedKitName="Objects")  # -> Data, Info
receive = Receive(
    Stream=panel,
    AutoReceive=False,
    CurrentComponentState="up_to_date",
    ExpandOutput=True,
    LastInfoMessage="ERVA Hofi @ 03/17/2025 01:21:09: Pushed 50 elements from Grasshopper. (id:bba7fa4c76)",
    ReceiveOnOpen=False,
    ReceivedCommitId="bba7fa4c76",
    StreamWrapper="https://macad.speckle.xyz/projects/28a211b286/models/structure/towers/v4/floorplates",
    selectedKitName="Objects")  # -> Info, Data
surface = Surface(graft(receive.Data))
radius_bottom = Slider(26, range=10..30)
of_columns_main_beams = Slider(10, range=0..30)
radius_top = Slider(16, range=10..20)
is_planar = IsPlanar(Surface=surface, Interior=True)  # -> Planar, Plane
project = Project(Geometry=surface, Plane=is_planar.Plane)  # -> Geometry, Transform
area = Area(Geometry=project.Geometry)  # -> Area, graft(Centroid)
# Towers Structural System
list_item = ListItem(List=flatten(area.Centroid), Index=0, Wrap=True)  # -> Item1, Item
circle = Circle(Plane=list_item.Item1, Radius=radius_top)
circle_2 = Circle(Plane=list_item.Item, Radius=radius_bottom)
divide_curve = DivideCurve(Curve=circle, Count=of_columns_main_beams, Kinks=False)  # -> Points, Tangents, Parameters
divide_curve_2 = DivideCurve(Curve=circle_2, Count=of_columns_main_beams, Kinks=False)  # -> Points, Tangents, Parameters
line = Line(StartPoint=divide_curve.Points, EndPoint=divide_curve_2.Points)
surface_2 = Surface(flatten(surface))
panel_2 = Panel("""0
-1""")
cull_index = CullIndex(List=surface_2, Indices=panel_2, Wrap=True)  # -> graft(List)
split_with_breps = SplitWithBreps(Curve=line, Brep=flatten(cull_index))  # -> Curve, Points
panel_3 = Panel(line)
flip_matrix = FlipMatrix(Data=split_with_breps.Curve)
curve = Curve(flip_matrix)
series = Series(Start="1", Step=1, Count="47")
panel_4 = Panel(curve)
eval = Evaluate(F="3*((2+(N-2)*0.7)/N)", N=series)
ma = MassAddition(Input=eval)  # -> Result, PartialResults
total_load_kn = Panel(ma.Result)
sum_of_kn_floor = Panel(ma.PartialResults)
kn_floor = Panel(eval)
panel_5 = Panel(sum_of_kn_floor)
multiplication = Multiplication(A=panel_5, B="10000")
expression = Expression(P=multiplication, Expression="Sqrt(P / (10^7))")
panel_6 = Panel(expression)
len = Length(Curve=curve)
item = ListItem(List=len, Index=0, Wrap=True)
multiplication_2 = Multiplication(A=panel_6, B=Slider(2, range=0..10))
rectangle = Rectangle(Plane=curve, XSize=graft(multiplication_2), YSize=graft(multiplication_2), Radius=0)  # -> Rectangle, Length
neg = Negative(Value=item)
num = Number(multiplication)
multiplication_3 = Multiplication(A=multiplication_2, B="100")
srf = Surface(rectangle.Rectangle)
Z = UnitZ(Factor=neg)
expression_2 = Expression(P=num, L=multiplication_3, b=multiplication_2, E="20e9", Expression="(P * L) / (b^2 * E)")
panel_7 = Panel(multiplication_2)
extr = Extrude(Base=srf, Direction=Z)
panel_8 = Panel(expression_2)
multiplication_4 = Multiplication(A=panel_8, B="1000")
panel_9 = Panel(multiplication_4)
item_2 = ListItem(List=panel_9, Index="-1", Wrap=True)
panel_10 = Panel(item_2)

cso = CreateSpeckleObject(A=curve, selectedKitName="Objects")
cso_2 = CreateSpeckleObject(B=rectangle.Rectangle, selectedKitName="Objects")
cso_3 = CreateSpeckleObject(C=extr, selectedKitName="Objects")
panel_11 = Panel("https://macad.speckle.xyz/projects/28a211b286/models/4104f63f5f")
cso_4 = CreateSpeckleObject(ColumnsCurves=cso, CrossSection=cso_2, Columns=cso_3, selectedKitName="Objects")
send = Send(
    Stream=panel_11,
    Data=cso_4,
    AutoSend=False,
    BaseId="17d2769b87499ce1acec5f5e8e27556e",
    CurrentComponentState="up_to_date",
    KitName="Objects",
    OutputWrappers="https://macad.speckle.xyz\t28a211b286\t2f6f3bdaf6",
    UseDefaultCache=True,
    selectedKitName="Objects")

panel_12 = Panel("https://macad.speckle.xyz/projects/28a211b286/models/b713bb2f52")
panel_13 = Panel("https://macad.speckle.xyz/projects/28a211b286/models/ca1b219383")
panel_14 = Panel("https://macad.speckle.xyz/projects/28a211b286/models/49ac08c803")
send_2 = Send(
    Stream=panel_13,
    ColumnsCurves=curve,
    AutoSend=False,
    BaseId="ecfe66b4995a9118c2ede15dce5f2a57",
    CurrentComponentState="up_to_date",
    KitName="Objects",
    OutputWrappers="https://macad.speckle.xyz\t28a211b286\t08f0720ce4",
    UseDefaultCache=True,
    selectedKitName="Objects")
send_3 = Send(
    Stream=panel_14,
    CrossSection=rectangle.Rectangle,
    AutoSend=False,
    BaseId="354292fd2e46af7f2ae0c8d2097276ca",
    CurrentComponentState="up_to_date",
    KitName="Objects",
    OutputWrappers="https://macad.speckle.xyz\t28a211b286\t8f61e1a127",
    UseDefaultCache=True,
    selectedKitName="Objects")
send_4 = Send(
    Stream=panel_12,
    Loads=multiplication,
    AutoSend=False,
    BaseId="fc1ea0ea36538d76637e82f9e114fada",
    CurrentComponentState="up_to_date",
    KitName="Objects",
    OutputWrappers="https://macad.speckle.xyz\t28a211b286\t47e7f026c5",
    UseDefaultCache=True,
    selectedKitName="Objects")
