# Grasshopper definition structure optimization.gh (Grasshopper 1.0.8)
# plug-ins: Speckle 2

panel = Panel("https://macad.speckle.xyz/projects/28a211b286/models/49ac08c803")
panel_2 = Panel("https://macad.speckle.xyz/projects/28a211b286/models/b713bb2f52")
panel_3 = Panel("https://macad.speckle.xyz/projects/28a211b286/models/ca1b219383")
receive = Receive(
    Stream=panel_3,
    AutoReceive=False,
    CurrentComponentState="expired",
    ExpandOutput=True,
    LastInfoMessage="ERVA Hofi @ 03/17/2025 03:56:15: Pushed 472 elements from Grasshopper. (id:08f0720ce4)",
    ReceiveOnOpen=False,
    ReceivedCommitId="08f0720ce4",
    StreamWrapper="https://macad.speckle.xyz/projects/28a211b286/models/structure/towers/v4/columns-curves",
    selectedKitName="Objects")  # -> Info, ColumnsCurves
receive_2 = Receive(
    Stream=panel,
    AutoReceive=False,
    CurrentComponentState="expired",
    ExpandOutput=True,
    LastInfoMessage="ERVA Hofi @ 03/17/2025 03:56:14: Pushed 472 elements from Grasshopper. (id:8f61e1a127)",
    ReceiveOnOpen=False,
    ReceivedCommitId="8f61e1a127",
    StreamWrapper="https://macad.speckle.xyz/projects/28a211b286/models/structure/towers/v4/columns-crosssection",
    selectedKitName="Objects")  # -> Info, CrossSection
receive_3 = Receive(
    Stream=panel_2,
    AutoReceive=False,
    CurrentComponentState="expired",
    ExpandOutput=True,
    LastInfoMessage="ERVA Hofi @ 03/17/2025 03:56:16: Pushed 2 elements from Grasshopper. (id:47e7f026c5)",
    ReceiveOnOpen=False,
    ReceivedCommitId="47e7f026c5",
    StreamWrapper="https://macad.speckle.xyz/projects/28a211b286/models/structure/towers/v4/columns-loads",
    selectedKitName="Objects")  # -> Info, Loads

crv = Curve(receive.ColumnsCurves)
panel_4 = Panel(crv)
num = Number(receive_3.Loads)
crv_2 = Curve(receive_2.CrossSection)
area = Area(Geometry=crv_2)  # -> Area, Centroid
panel_5 = Panel(area.Area)
scale = Scale(Geometry=crv_2, Center=area.Centroid, Factor=Slider(1.1, range=0..10))  # -> Geometry, Transform
srf = Surface(scale.Geometry)
area_2 = Area(Geometry=scale.Geometry)  # -> Area, Centroid
expression = Expression(x=area_2.Area, Expression="sqrt(x)")
panel_6 = Panel(expression)
item = ListItem(List=flatten(panel_6), Index="1", Wrap=True)
panel_7 = Panel(item)
multiplication = Multiplication(A=expression, B=Slider(1, range=0..10))
multiplication_2 = Multiplication(A=multiplication, B="100")
rectangle = Rectangle(Plane=crv, XSize=graft(panel_7), YSize=graft(panel_7), Radius=0)  # -> Rectangle, Length
srf_2 = Surface(rectangle.Rectangle)
expression_2 = Expression(P=num, L=multiplication_2, b=multiplication, E="20e9", Expression="(P * L) / (b^2 * E)")
panel_8 = Panel(multiplication)
extrcrv = ExtrudeAlong(Base=srf_2, Curve=crv)
extrcrv_2 = ExtrudeAlong(Base=srf, Curve=crv)
volume = Volume(Geometry=extrcrv)  # -> Volume, Centroid
panel_9 = Panel(expression_2)
panel_10 = Panel(area_2.Area)
volume_2 = Volume(Geometry=extrcrv_2)  # -> Volume, Centroid
panel_11 = Panel(volume.Volume)
ma = MassAddition(Input=flatten(volume.Volume))  # -> Result, PartialResults
ma_2 = MassAddition(Input=flatten(volume_2.Volume))  # -> Result, PartialResults
panel_12 = Panel(volume_2.Volume)
panel_13 = Panel(ma.Result)
panel_14 = Panel(ma_2.Result)
multiplication_3 = Multiplication(A=panel_9, B="1000")
panel_15 = Panel(multiplication_3)
item_2 = ListItem(List=flatten(panel_15), Index="-1", Wrap=True)
division = Division(A=panel_14, B=panel_13)
panel_16 = Panel(item_2)
panel_17 = Panel(division)

cso = CreateSpeckleObject(A=crv, selectedKitName="Objects")
cso_2 = CreateSpeckleObject(B=scale.Geometry, selectedKitName="Objects")
cso_3 = CreateSpeckleObject(C=extrcrv_2, selectedKitName="Objects")
panel_18 = Panel("https://macad.speckle.xyz/projects/28a211b286/models/4104f63f5f")
cso_4 = CreateSpeckleObject(ColumnsCurves=cso, CrossSection=cso_2, Columns=cso_3, selectedKitName="Objects")
send = Send(
    Stream=panel_18,
    Data=cso_4,
    AutoSend=False,
    BaseId="1f6c6f671c6e5e539a30da8e28568537",
    CurrentComponentState="expired",
    KitName="Objects",
    OutputWrappers="https://macad.speckle.xyz\t28a211b286\tedbb6769d7",
    UseDefaultCache=True,
    selectedKitName="Objects")

panel_19 = Panel("https://macad.speckle.xyz/projects/28a211b286/models/b713bb2f52")
panel_20 = Panel("https://macad.speckle.xyz/projects/28a211b286/models/ca1b219383")
panel_21 = Panel("https://macad.speckle.xyz/projects/28a211b286/models/49ac08c803")
send_2 = Send(
    Stream=panel_20,
    ColumnsCurves=crv,
    AutoSend=False,
    BaseId="ecfe66b4995a9118c2ede15dce5f2a57",
    CurrentComponentState="expired",
    KitName="Objects",
    OutputWrappers="https://macad.speckle.xyz\t28a211b286\tafec437bbb",
    UseDefaultCache=True,
    selectedKitName="Objects")
send_3 = Send(
    Stream=panel_21,
    CrossSection=scale.Geometry,
    AutoSend=False,
    BaseId="b0df6c97333ae48531b73e89beb85a2c",
    CurrentComponentState="expired",
    KitName="Objects",
    OutputWrappers="https://macad.speckle.xyz\t28a211b286\t78ce8f24d8",
    UseDefaultCache=True,
    selectedKitName="Objects")
send_4 = Send(
    Stream=panel_19,
    Loads=num,
    AutoSend=False,
    BaseId="fc1ea0ea36538d76637e82f9e114fada",
    CurrentComponentState="expired",
    KitName="Objects",
    OutputWrappers="https://macad.speckle.xyz\t28a211b286\tc8c1252be2",
    UseDefaultCache=True,
    selectedKitName="Objects")
